test file "sample_teat"

suite "TestSuite1"

  case "TestCase1" [baseline]
    model sample_model, harness sample_model_Harness1
    assessment "Assessment1": At any point of time, Symbol1 must be less than or equal to 10
      Symbol1: signal sample_model_Harness1/Output Conversion Subsystem, port 1

  case "TestCase2" [baseline]
    model sample_model, harness sample_model_Harness1
    assessment "Assessment1": At any point of time, Symbol1 must be greater than or equal to -5
      Symbol1: signal sample_model_Harness1/Output Conversion Subsystem, port 1

  case "TestCase3" [baseline]
    model sample_model, harness sample_model_Harness1
    assessment "Assessment1": At any point of time, Symbol1 must be greater than -15 and less than 15
      Symbol1: signal sample_model_Harness1/Output Conversion Subsystem, port 1

  case "TestCase4" [baseline]
    model sample_model, harness sample_model_Harness1
    assessment "Assessment1": At any point of time, Symbol1 must be less than or equal to 10 or greater than or equal to 20
      Symbol1: signal sample_model_Harness1/Output Conversion Subsystem, port 1