test file "sample_test"

suite "test_suite1"

  case "test_case1" [baseline]
    model sample_model, harness sample_model_Harness1
    assessment "Assessment1": At any point of time, Symbol1 must be less than or equal to 10
    assessment "Assessment2" (off): At any point of time, Symbol1 must be greater than or equal to -10
    assessment "Assessment3" (off): At any point of time, Symbol1 must be greater than -15 and less than 15
      Symbol1: signal sample_model_Harness1/Output Conversion Subsystem, port 1

  case "test_case2" [baseline]
    model sample_model, harness sample_model_Harness1
    assessment "Assessment1" (off): At any point of time, Symbol1 must be less than or equal to 10
    assessment "Assessment2": At any point of time, Symbol1 must be greater than or equal to -10
    assessment "Assessment3" (off): At any point of time, Symbol1 must be greater than -15 and less than 15
      Symbol1: signal sample_model_Harness1/Output Conversion Subsystem, port 1

  case "test_case3" [baseline]
    model sample_model, harness sample_model_Harness1
    assessment "Assessment1" (off): At any point of time, Symbol1 must be less than or equal to 10
    assessment "Assessment2" (off): At any point of time, Symbol1 must be greater than or equal to -10
    assessment "Assessment3": At any point of time, Symbol1 must be greater than -15 and less than 15
      Symbol1: signal sample_model_Harness1/Output Conversion Subsystem, port 1